# Grasshopper definition CRV_TO_GCODE.gh (Grasshopper 0.9.76)
# plug-ins: Python Interpreter

sub_division_length = Panel("1")

# ---- group: CURVE INPUT
crv = Curve([<curve referenced from the Rhino model> x80])

# ----
crv_2 = Curve(<curve referenced from the Rhino model>)
divlength = DivideLength(Curve=crv, Length=sub_division_length)  # -> Points, Tangents, Parameters
cp = ControlPoints(Curve=crv_2)  # -> Points, Weights, Knots

# ---- group: SUB-DIVISION PREVIEW
pline = PolyLine(Vertices=divlength.Points, Closed=False)

# ----
python = PythonScript(x=cp.Points)  # -> out, a; inputs x: list of Point3d
# ---------- python: Python ----------
a = []

for i in range(len(x)):
    a.append( "G00 X%f Y%f" %(x[i].X, x[i].Y) )
# ---------- end python ----------
python_2 = PythonScript(p=divlength.Points)  # -> out, flatten(a); inputs p: list of Point3d
# ---------- python_2: Python ----------
a = []

a.append( "G00 X%f Y%f" %(x[0].X, x[0].Y) )

for i in range(1,len(x)):
    a.append( "G01 X%f Y%f" %(x[i].X, x[i].Y) )
# ---------- end python_2 ----------
panel = Panel(python.a)
panel_2 = Panel(python_2.a)
