# Grasshopper definition crvs_to_gcode.gh (Grasshopper 0.9.76)
# plug-ins: Python Interpreter

python = PythonScript()  # -> path
# ---------- python: Python ----------
import pickle

path = ghenv.LocalScope.ghdoc.Path
path = path.split("\\")
#print path
path = "\\".join(path[:-3]) + "\\gcode"
print path
# ---------- end python ----------
crv = Curve(<curve referenced from the Rhino model>)
python_2 = PythonScript(crvs=crv, p=python)  # -> out, a; inputs crvs: list of Curve
# ---------- python_2: Python ----------
import rhinoscriptsyntax as rs

fp = 'C:\\Users\\Lorenzo\\Google Drive\\lv\\Projects\\4XiDraw\\axi_draw\\PYTHON_SCRIPTS\\gcode_out.txt'
print fp

inCrv = crvs
#print inCrv

if len(inCrv) > 0:
    inCrv = sorted(inCrv, key=lambda k:rs.CurveStartPoint(k).Y)

#subD = rs.GetReal("Input segment length", number=1.0)

with open(fp, mode='w') as outfile:
    if len(inCrv) >= 1:
        for crv in inCrv:
            
            pts = rs.DivideCurve(crv, 1)
            
            
            for i, pt in enumerate(pts):
                if i == 0:
                    #raise pen
                    outfile.write("M03 S0 \n")
                    #go to first position
                    outfile.write("G00 X%.3f Y%.3f \n" %(pt.X,pt.Y) )
                    #drop pen
                    outfile.write("M03 S1024 \n")
                    continue
                #go to next position (with pen down)
                outfile.write("G00 X%.3f Y%.3f \n" %(pt.X,pt.Y) )
            #lift pen
            outfile.write("M03 S0 \n")
        outfile.write("G00 X0 Y0 \n")

outfile.close()
# ---------- end python_2 ----------
